# Grasshopper definition Micro_Worlds.gh (Grasshopper 1.0.7)

# ---- group: VOXEL WORLD / User Input
# Input: These are the parameters to alter when generating terrain.
# 
# Lowlands include: water, plains, low hills
# 
# Midlands include: hills, plateaus
# 
# Highlands include: stone and snow mountains
# Press the "Run" icon in the component below to generate terrain!
# 
# Note: The component below is a Data Dam. If the "Run" button can't be pressed, change the parameters (percentage and terrain type).
# Set the desired percentage of *specified terrain type* ---->
# KNOWN BUGS: The following bugs might occur:
# 
# - The GA might ocassionally provide an inaccurate solution due to the limited number of individuals and generations
# 
# - When optimizing for "Terrain Specification: Midlands" (in RED SECTION), solutions are often inaccurate
# 
# - Changing the height scaling in ORANGE section might bug the tree Z positions, depending on the terrain type.
# 
# - Switching to "show player vicinity" in YELLOW section while the scaling in ORANGE section is not "Regular" might bug tree positions
# Specify the type of terrain that you want to generate *specified percentage* of ---->
list = ValueList({"Terrian Specification: Lowlands": "lowlands", "Terrian Specification: Midlands": "midlands", "Terrian Specification: Highlands": "highlands"}, selected="Terrian Specification: Lowlands")
# Morphogenetic Programming Assignment A6: Micro (Voxel-Based) World Generator
# STARTING NOTES: On my machine, solutions take between 20 to 120 seconds to complete (it might take longer on different computers).
# 
# The best results were obtained by optimizing for "Lowlands" type of terrain (in RED section), at "Regular" height scaling (in Orange section).
# 
# Advice: For bugfree experience, stick to "Regular"  scaling in ORANGE section
desired_percentage = Slider(45, range=20..80)
# Percentages of the 3 types of terrain in the generated terrain map ---->
# The genes of the 100 individuals used in the GA to generate a map ---->
user_input = CSharpScript(desiredPercentage=desired_percentage, specifiedTerrain=list)  # -> out, SentData; inputs desiredPercentage: Int32, specifiedTerrain: String
# ---------- user_input: C# ----------
    // RUNTIME CODE

    data = GenerateData(desiredPercentage, specifiedTerrain);

    // OUTPUT
    SentData = data;
# ---------- user_input: C# additional code ----------
  // CODE:

  // This is the data that will be sent to the map generator
  public List<int> data = new List<int>();

  // This dictionary associates categorical string data for terrain type with integers
  public static Dictionary<string, int> categoricalData = new Dictionary<string, int>() {{"lowlands", 0}, {"midlands", 1}, {"highlands", 2}};

  // Static method that packs all user input into a list of integers
  public static List<int> GenerateData(int desiredPercentage, string specifiedTerrain)
  {
    List<int> data = new List<int>();

    data.Add(desiredPercentage);
    data.Add(categoricalData[specifiedTerrain]);

    return data;
  }
# ---------- end user_input ----------
dam = DataDam(DataGenerate=user_input.SentData, BufferDelay=10000000, BufferMode=0)

# ---- group: VOXEL WORLD / Generator
# Terrain Scaling: After generating the initial map, you can change the scaling of the terrain from the drop-down list below.
# 
# Note: The percentages in the initial generation match the "Regular" height scaling option
map_generator = CSharpScript(userInput=dam)  # -> out, Path, Percentages, Genes; inputs userInput: list of Int32
# ---------- map_generator: C# usings ----------
using System.IO;
using System.Drawing;
using System.Reflection;
using System.Linq;
# ---------- map_generator: C# ----------
    // RUNTIME CODE

    if(userInput != null)
    {
      // Create a new Bitmap of size 128 by 128
      BitmapGenerator bg = new BitmapGenerator(128);

      // Determine GA parameters based on received user input
      fitnessCriteria = userInput[1];
      if (fitnessCriteria == 0) desiredFeatures = new double[3] {userInput[0], 0, 0};
      else if (fitnessCriteria == 1) desiredFeatures = new double[3] {0, userInput[0], 0};
      else if (fitnessCriteria == 2) desiredFeatures = new double[3] {0, 0, userInput[0]};
      else desiredFeatures = null;

      // Using L-Systems and image processing, generate a height map.
      bg.generateBitmap();
      // Record percentages of height-classified areas
      currentFeatures = bg.percentages;


      // OUTPUT
      Path = bg.savePath;
      Percentages = new List<string>() {"Lowlands & water: " + (Math.Round(currentFeatures[0], 2)).ToString() + "%",
          "Midlands & Hills: " + (Math.Round(currentFeatures[1], 2)).ToString() + "%",
          "Highlands & Mountains: " + (Math.Round(currentFeatures[2], 2)).ToString() + "%"};

      Genes = populationGenesList;
    }
# ---------- map_generator: C# additional code ----------
  // REFERENCES:
  // Some of the code in the "L_System" class is inspired from lecture material from Morphogenetic Programming (Semester 2) module taught in the AC MSc at UCL
  // Some of the code in the GENETIC ALGORITHM classes is inspired from lecture material from Morphogenetic Programming (Semester 2) module taught in the AC MSc at UCL
  // The code in the "Blur" static method is based on Eric Willis's code. Source: https://gist.github.com/superic/8165746
  // Note: Willis's code produced artifacts at the edge of bitmaps, resulting in vertical massings in the model, code was altered to remedy this.


  // CODE:


  // FIELDS:

  public static Random rnd = new Random();
  // currentFeatures[0] is lowlands & water. currentFeatures[1] is midlands & hills. currentFeatures[2] is highlands & mountains.
  public double[] currentFeatures = new double[3];
  // fitnessCriteria is the integer associated with the terrain type to be optimized for
  public static int fitnessCriteria = 0;
  // desiredFeatures holds the variables that represent the user's request/specification (lowlands, midlands, highlands)
  public static double[] desiredFeatures;
  // List of all the individual fitnesses of L-Systems generated by the GA
  public static List<double> populationFitnessList = new List<double>();
  // List of all the genes used by the GA to generate various L-Systems
  public static List<string> populationGenesList = new List<string>();



  // METHODS:


  // METHOD 1: PERCENT
  // This static method determines the percent of a value from another value
  private static double Percent(int current, int cap)
  {
    double percent;

    percent = ((double) current / (double) cap) * 100;

    return percent;
  }


  // METHOD 2: GET MAP PERCENTAGES
  // Static method that gets the percentage of 'lowland' ,'midland' and 'highland' pixels on the bitmap based on their values
  public static double[] getPercentages(Bitmap bitmap)
  {
    double[] percentages = new double[3];

    int numberOfPixels = bitmap.Width * bitmap.Height;

    // 'Lowland' includes water and low-height grass areas
    int lowlandPixels = 0;
    // 'Midland' includes mid-height grass and stone areas
    int hillsPixels = 0;
    // 'Highland' includes moderate stone peaks and high snow-covered mountains
    int mountainPixels = 0;

    for (int i = 0; i < bitmap.Width; i++)
    {
      for (int j = 0; j < bitmap.Height; j++)
      {
        Color currentPixel = bitmap.GetPixel(i, j);

        if(currentPixel.R >= 200) mountainPixels += 1;
        else if (currentPixel.R == 0) lowlandPixels += 1;
        else hillsPixels += 1;
      }
    }

    double lowlandPercentage = Percent(lowlandPixels, numberOfPixels);
    double hillsPercentage = Percent(hillsPixels, numberOfPixels);
    double mountainPercentage = Percent(mountainPixels, numberOfPixels);

    percentages[0] = lowlandPercentage;
    percentages[1] = hillsPercentage;
    percentages[2] = mountainPercentage;

    return percentages;
  }


  // METHOD 3: BLUR **
  // This method blurs an input bitmap by a specified amount
  private static Bitmap Blur(Bitmap image, int blurSize)
  {
    Rectangle rectangle = new Rectangle(0, 0, 128, 128);
    Bitmap blurred = new Bitmap(image);

    // Iterate through every pixel in the image
    for (int i = rectangle.X; i < rectangle.X + rectangle.Width; i++)
    {
      for (int j = rectangle.Y; j < rectangle.Y + rectangle.Height; j++)
      {
        int averageR = 0;
        int averageG = 0;
        int averageB = 0;

        int blurPixelCount = 0;

        // Average the brightness of all pixels in the blur area (determined by blurSize)
        for (int x = i; (x < i + blurSize && x < image.Width); x++)
        {
          for (int y = j; (y < j + blurSize && y < image.Height); y++)
          {
            // The source code used only pixels from "blurred" bitmap, which often resulted in unwanted artifacts
            // I opted to create an average between the values from "blurred" and the manipulated image, and the artifacts were corrected
            Color pixelColourI = image.GetPixel(x, y);
            Color pixelColourB = blurred.GetPixel(x, y);

            averageR += (int) (pixelColourB.R + pixelColourI.R) / 2;
            averageG += (int) (pixelColourB.G + pixelColourI.G) / 2;
            averageB += (int) (pixelColourB.B + pixelColourI.B) / 2;

            blurPixelCount++;
          }
        }

        averageR = averageR / blurPixelCount;
        averageG = averageG / blurPixelCount;
        averageB = averageB / blurPixelCount;

        // Set each pixel in the bitmap to the new blurred value
        for (int x = i; x < i + blurSize && x < image.Width && x < rectangle.Width; x++)
        {
          for (int y = j; y < j + blurSize && y < image.Height && y < rectangle.Height; y++)
          {
            blurred.SetPixel(x, y, Color.FromArgb(averageR, averageG, averageB));
          }
        }

      }

    }

    return blurred;
  }



  // CLASSES:

  // CLASS 1: BITMAP GENERATOR
  // This class uses L-Systems to generate a bitmap that will be passed to a world mesh generator.
  public class BitmapGenerator
  {
    // Fields
    public Bitmap bitmap;
    public string savePath = Directory.GetCurrentDirectory() + "\\Assignment_A6_Generated_Map.jpg";

    public double[] percentages = new double[3];

    // Constructor
    public BitmapGenerator(int bitmapSize)
    {
      Bitmap initial = new Bitmap(1, 1);
      initial.SetPixel(0, 0, Color.Black);

      this.bitmap = new Bitmap(initial, bitmapSize, bitmapSize);
    }

    // Methods

    // Method that sets the values for bitmap pixels
    public void generateBitmap()
    {
      // Use a genetic algorithm to determine what parameters to use in the L-Systems that generate the height map
      Population LSystemPopulation = new Population(100, bitmap, fitnessCriteria);

      int numberOfGenerations = 10;

      for (int j = 0; j < numberOfGenerations; j++)
      {
        LSystemPopulation.evolve();
      }

      // Pick the most fit individual from the population, and get the bitmap from its L-System phenotype
      bitmap = LSystemPopulation.population.Min().phenotype.system.bitmap;

      percentages = getPercentages(bitmap);


      // The bitmap has the outline of landmasses (white) on a plain (black)
      // Blur the bitmap to smooth out brightness values, and create 'slopes'
      bitmap = Blur(bitmap, 20);

      // Save the bitmap as a jpg in the same directory as this Grasshopper file
      bitmap.Save(savePath);
    }
  }




  // CLASS 2: L-SYSTEM *
  // This class uses a Lindenmayer system to create pixel formations on a Bitmap
  public class LSystem
  {
    // Fields
    public Bitmap bitmap;

    private int xPosition;
    private int yPosition;
    private int xStep;
    private int yStep;

    public Dictionary<char, string> rules;
    public string start;
    public string alphabet;

    private int iterationCap;
    private int heightSeparator;

    // Constructor
    public LSystem(Bitmap bitmap)
    {
      this.bitmap = bitmap;

      xStep = 1;
      yStep = 0;

      // Initial rules and start are similar to Dragon Curve (https://en.wikipedia.org/wiki/Dragon_curve)
      // The application of these rules (see methods below) is different
      rules = new Dictionary<char, string>() {{'X', "X+YF+"}, {'Y', "-FX-Y"}};
      start = "FX";
    }


    // Methods

    // Update the parameters of the L-System
    public void updateParameters(int iterationCap, int heightSeparator, int xPosition, int yPosition)
    {
      this.iterationCap = iterationCap;
      this.heightSeparator = heightSeparator;
      this.xPosition = xPosition;
      this.yPosition = yPosition;
    }

    // Method that iterates through all characters of the alphabet and applies the system rules to each, updating the alphabet
    private void updateAlphabet()
    {
      string updatedAlphabet = "";

      for (int i = 0; i < alphabet.Length; i++)
      {
        char currentCharacter = alphabet[i];

        if(rules.ContainsKey(currentCharacter))
        {
          updatedAlphabet += rules[currentCharacter];
        }

        else
        {
          updatedAlphabet += currentCharacter;
        }
      }

      alphabet = updatedAlphabet;
      applyRules();
    }

    // Method that applies the L-System rules to the Bitmap in a single step
    private void applyRules()
    {
      for (int i = 0; i < alphabet.Length; i++)
      {
        char currentSymbol = alphabet[i];

        // The 'F' character moves the current pixel to a new specified position on the bitmap and changes its value
        if(currentSymbol == 'F')
        {
          Color landmassColour;

          if(heightSeparator == 5)
          {
            landmassColour = Color.FromArgb(255, 255, 255);
          }

          else if (heightSeparator == 4)
          {
            landmassColour = Color.FromArgb(200, 200, 200);
          }

          else if (heightSeparator == 3)
          {
            landmassColour = Color.FromArgb(150, 150, 150);
          }

          else if (heightSeparator == 2)
          {
            landmassColour = Color.FromArgb(100, 100, 100);
          }

          else if (heightSeparator == 1)
          {
            landmassColour = Color.FromArgb(50, 50, 50);
          }

          else
          {
            landmassColour = Color.FromArgb(0, 0, 0);
          }

          bitmap.SetPixel(xPosition, yPosition, landmassColour);

          xPosition += xStep;
          yPosition += yStep;

          if(xPosition >= bitmap.Width) xPosition = 0;
          if(xPosition < 0) xPosition = bitmap.Width - 1;
          if(yPosition >= bitmap.Height) yPosition = 0;
          if(yPosition < 0) yPosition = bitmap.Height - 1;

          bitmap.SetPixel(xPosition, yPosition, landmassColour);
        }

          // The '+' symbol changes the orientation in which 'F' will perform value changes by 90 degrees clockwise
        else if(currentSymbol == '+')
        {
          if(xStep == 1)
          {
            // Right - Bottom orientation
            if(yStep == 1)
            {
              xStep = -1;
            }

              // Right orientation
            else if(yStep == 0)
            {
              xStep = 0;
              yStep = 1;
            }

              // Right - Top orientation
            else if(yStep == -1)
            {
              yStep = 1;
            }
          }

          else if(xStep == 0)
          {
            // Down orientation
            if(yStep == 1)
            {
              xStep = -1;
              yStep = 0;
            }

              // Static
            else if(yStep == 0)
            {
              continue;
            }

              // Top orientation
            else if(yStep == -1)
            {
              xStep = 1;
              yStep = 0;
            }
          }

          else if(xStep == -1)
          {
            // Left - Bottom orientation
            if(yStep == 1)
            {
              yStep = -1;
            }

              // Left orientation
            else if(yStep == 0)
            {
              xStep = 0;
              yStep = -1;
            }

              // Left - Top orientation
            else if(yStep == -1)
            {
              xStep = 1;
            }
          }

            // Handle any unforseen cases
          else
          {
            xStep = 0;
            yStep = 0;
          }
        }

          // The '-' symbol changes the orientation in which 'F' will perform value changes by 90 degrees counterclockwise
        else if(currentSymbol == '-')
        {
          if(xStep == 1)
          {
            // Right - Bottom orientation
            if(yStep == 1)
            {
              yStep = -1;
            }

              // Right orientation
            else if(yStep == 0)
            {
              xStep = 0;
              yStep = -1;
            }

              // Right - Top orientation
            else if(yStep == -1)
            {
              xStep = -1;
            }
          }

          else if(xStep == 0)
          {
            // Down orientation
            if(yStep == 1)
            {
              xStep = 1;
              yStep = 0;
            }

              // Static
            else if(yStep == 0)
            {
              continue;
            }

              // Top Orientation
            else if(yStep == -1)
            {
              xStep = -1;
              yStep = 0;
            }
          }

          else if(xStep == -1)
          {
            // Left - Bottom orientation
            if(yStep == 1)
            {
              xStep = 1;
            }

              // Left orientation
            else if(yStep == 0)
            {
              xStep = 0;
              yStep = 1;
            }

              // Left - Top orientation
            else if(yStep == -1)
            {
              yStep = 1;
            }
          }

            // Handle any unforseen cases
          else
          {
            xStep = 0;
            yStep = 0;
          }
        }
      }
    }

    // Method that applies the rules to the bitmap iteratively
    public void Iterate()
    {
      alphabet = start;
      applyRules();

      for (int i = 0; i < iterationCap; i++)
      {
        updateAlphabet();
      }
    }

  }




  // GENETIC ALGORITHM CLASSES
  // These classes used together modify the parameters of the map-generating L-Systems


  // CLASS 3: GENOTYPE
  public class Genotype
  {
    // Fields
    public int[] genes;

    // Constructor
    public Genotype()
    {
      // The gene pool contains 5 genes
      genes = new int[5];

      // This gene is the iteration cap for L-Systems. It determines the sprawl/spread/surface of landmasses
      genes[0] = rnd.Next(1, 15);
      // This gene determines the height of landmasses
      genes[1] = rnd.Next(6);
      // This gene is the starting x position of the L-System on the bitmap
      genes[2] = rnd.Next(128);
      // This gene is the starting y position of the L-System on the bitmap
      genes[3] = rnd.Next(128);
      // This gene determines whether a landmass will be created at all
      genes[4] = rnd.Next(2);
    }

    // Methods
    public void mutate()
    {
      // Mutation chance set to 5%
      if(rnd.NextDouble() < 0.05) genes[0] = rnd.Next(1, 15);
      if(rnd.NextDouble() < 0.05) genes[1] = rnd.Next(6);
      if(rnd.NextDouble() < 0.05) genes[2] = rnd.Next(128);
      if(rnd.NextDouble() < 0.05) genes[3] = rnd.Next(128);
      if(rnd.NextDouble() < 0.05) genes[4] = rnd.Next(2);
    }

  }




  // CLASS 4: PHENOTYPE
  public class Phenotype
  {
    // Fields
    double[] features;

    public LSystem system;

    bool createLSystem;
    int LSystemIterationCap;
    int LSystemHeightSeparator;
    int xPosition;
    int yPosition;

    // Constructor
    public Phenotype(Genotype genotype, Bitmap bitmap)
    {
      // Create a new L-System based on passed bitmap
      system = new LSystem(bitmap);

      // Create L-system parameters based on Genotype genes
      LSystemIterationCap = genotype.genes[0];
      LSystemHeightSeparator = genotype.genes[1];
      xPosition = genotype.genes[2];
      yPosition = genotype.genes[3];
      createLSystem = (genotype.genes[4] == 1);

      if(createLSystem)
      {
        // Update L-System with said parameters
        system.updateParameters(LSystemIterationCap, LSystemHeightSeparator, xPosition, yPosition);

        // Iterate through successive steps of the L-System with said parameters
        system.Iterate();
      }

      // Get quantified results of what sort of map the system generated
      features = getPercentages(system.bitmap);

    }

    // Methods
    public double evaluateFitness(int fitnessCriteria)
    {
      // Fitness here is determined by how close the generated features (percentages) are to the desired features (percentages)
      // fitnessCriteria is the integer associated with the desired terrain type

      double fitness = 0.0;

      double lowlandsAccuracy = Math.Abs(desiredFeatures[0] - features[0]);
      double midlandsAccuracy = Math.Abs(desiredFeatures[1] - features[1]);
      double highlandsAccuracy = Math.Abs(desiredFeatures[2] - features[2]);

      if(fitnessCriteria == 0) fitness = lowlandsAccuracy;
      else if(fitnessCriteria == 1) fitness = midlandsAccuracy;
      else if(fitnessCriteria == 2) fitness = highlandsAccuracy;
      else fitness = 0;

      return fitness;
    }

  }




  // CLASS 5: INDIVIDUAL
  public class Individual : IComparable
  {
    // Fields
    public Genotype genotype;
    public Phenotype phenotype;
    public double fitness;


    // Constructor
    public Individual(Bitmap bitmap)
    {
      this.genotype = new Genotype();
      this.phenotype = new Phenotype(genotype, bitmap);
      this.fitness = 0.0;
    }

    // Methods

    public void evaluateFitness(int fitnessCriteria)
    {
      fitness = phenotype.evaluateFitness(fitnessCriteria);
    }

    // implementing IComparable functionality to compare elements. Will compare based on fitness.
    public int CompareTo(Object objI)
    {
      Individual iToCompare = (Individual) objI;

      if(fitness < iToCompare.fitness) return -1;
      else if (fitness > iToCompare.fitness) return 1;
      else return 0;
    }

  }




  // CLASS 6: POPULATION
  public class Population
  {
    // Fields
    public Individual[] population;

    private int numberOfIndividuals;
    public Bitmap bitmap;
    public Bitmap[] geneticBitmaps;
    public int fitnessCriteria;

    // Constructor
    public Population(int numberOfIndividuals, Bitmap bitmap, int fitnessCriteria)
    {
      this.numberOfIndividuals = numberOfIndividuals;
      this.bitmap = bitmap;
      this.fitnessCriteria = fitnessCriteria;

      geneticBitmaps = new Bitmap[numberOfIndividuals];
      population = new Individual[numberOfIndividuals];

      for (int i = 0; i < numberOfIndividuals; i++)
      {
        geneticBitmaps[i] = new Bitmap(bitmap);
        population[i] = new Individual(geneticBitmaps[i]);
        population[i].evaluateFitness(fitnessCriteria);
      }

      // Sorting via IComparable functionality from Individual
      Array.Sort(population);
    }

    // Methods

    // Method that generates child individuals, evaluates, and re-sorts the population absed on fitness
    public void evolve()
    {
      Individual parent1;
      Individual parent2;
      Individual child;

      populationFitnessList.Clear();
      populationGenesList.Clear();


      for (int i = 0; i < numberOfIndividuals; i++)
      {
        parent1 = selectIndividual();
        parent2 = selectIndividual();

        child = Evolution.breed(parent1, parent2, geneticBitmaps[i]);

        // Introduce child in the population, evaluate its fitness, and stort the population
        population[i] = child;
        population[i].evaluateFitness(fitnessCriteria);

        // Store population data
        populationFitnessList.Add(child.fitness);
        populationGenesList.Add(child.genotype.genes[0].ToString() + ", " + child.genotype.genes[1].ToString() + ", " +
          child.genotype.genes[2].ToString() + ", " + child.genotype.genes[3].ToString() + ", " + child.genotype.genes[4].ToString());

        Array.Sort(population);
      }

    }

    // Method that randomly selects an individual from the population
    public Individual selectIndividual()
    {
      int index = (int) Math.Floor(((double) numberOfIndividuals - 0.001) * (1.0 - Math.Pow(rnd.NextDouble(), 2)));

      Individual selected = population[index];

      return selected;
    }
  }



  // CLASS 7: EVOLUTION
  public static class Evolution
  {
    // Methods

    // This method implements crossover functionality for 2 Genotype instances
    public static Genotype crossover (Genotype genotype1, Genotype genotype2)
    {
      Genotype resultingGenotype = new Genotype();

      for (int i = 0; i < resultingGenotype.genes.Length; i++)
      {
        if(rnd.Next(100) < 50) resultingGenotype.genes[i] = genotype1.genes[i];
        else resultingGenotype.genes[i] = genotype2.genes[i];
      }

      return resultingGenotype;
    }


    // This method uses crossover to create a child Individual from 2 given parent Individuals
    public static Individual breed(Individual parent1, Individual parent2, Bitmap bitmap)
    {
      Individual child = new Individual(bitmap);

      child.genotype = crossover(parent1.genotype, parent2.genotype);
      child.genotype.mutate();

      child.phenotype = new Phenotype(child.genotype, bitmap);

      return child;
    }
  }
# ---------- end map_generator ----------
percentages = Panel(map_generator.Percentages)
population_genes_list = Panel(map_generator.Genes)
list_2 = ValueList({"Flat": 1, "Regular": 2, "High": 3, "Exaggerated": 5}, selected="Regular")
voxel_world_creation = CSharpScript(terrainHeightScaling=list_2, path=map_generator.Path)  # -> out, VoxelWorldMesh, ForestMeshes; inputs terrainHeightScaling: Double, path: String
# ---------- voxel_world_creation: C# usings ----------
using System.IO;
using System.Drawing;
using Rhino.Geometry.Intersect;
# ---------- voxel_world_creation: C# ----------
    // TERMINOLOGY:

    // "VOXEL" in this project is the base building block. It holds information, such as its associated mesh, its neighbours, etc.
    // "CHUNK" in this project is a group of voxels (either present or absent) that for a larger sector of the world. Chunk size is 16 x 16 x 128 voxels
    // "WORLD" in this project is the group of all chunks that have been created.

    // RUNTIME CODE:

    voxelBinaryData.Clear();
    worldData.Clear();

    HeightMap heightMap = new HeightMap(path);
    // Get voxel binary arrays from generated heightmap
    voxelBinaryData = heightMap.generateWorldData(16, terrainHeightScaling);
    // Generate world data
    for (int i = 0; i < voxelBinaryData.Count; i++)
    {
      worldData.Add(new VoxelChunkData(voxelBinaryData[i]));
    }

    // Create the world from provided world data
    World voxelWorld = new World(worldData, terrainHeightScaling);

    // Populate the world with assets
    generatedForest = new Forest(heightMap.finalMap, terrainHeightScaling);

    // OUTPUT
    VoxelWorldMesh = voxelWorld.chunkMehses;
    ForestMeshes = generatedForest.trees;
# ---------- voxel_world_creation: C# additional code ----------
  // REFERENCES:
  // Initial inspiration for data structuring used in the VoxelChunkData class came from Board To Bits Games.
  // Source: https://www.youtube.com/watch?v=b_1ZlHrJZc4

  // FIELDS:

  public static Random rnd = new Random();
  public Forest generatedForest;

  // Store the voxel data
  public List<int[,,]> voxelBinaryData = new List<int[,,]>();
  public List<VoxelChunkData> worldData = new List<VoxelChunkData>();


  // METHODS:

  // METHOD 1: REMAP VALUE
  // Static method used to remap image brightness value to voxel chunk height data
  public static int Remap(float brightness, int newCap, double scalingFactor)
  {
    return (int) (0 + (brightness - 0) * (newCap * scalingFactor - 0) / (1 - 0));
  }


  // METHOD 2: RESIZE IMAGE
  // Static method that resizes an image to a new specified size
  public static Bitmap ResizeImage(Bitmap image, int newSize)
  {
    Bitmap resizedImage = new Bitmap(image, new Size(newSize, newSize));

    return resizedImage;
  }


  // CLASSES:

  // PART 1: CLASSES THAT DEAL WITH DATA PREPARATION


  // CLASS 1: CREATE DATA FOR VOXEL GENERATION
  // Class that uses the base height map stored in ImageFiles to create a data structure to be passed on to the voxel generator
  public class HeightMap
  {
    // Fields
    public Bitmap finalMap;
    public string path;

    // Constructor
    public HeightMap(string path)
    {
      this.path = path;
      finalMap = ResizeImage(new Bitmap(path), 128);
    }

    // Methods

    // This method splits the received image into equal tiles of a specified size
    // In the Voxel Chunk component, each tile will be used to generate a separate voxel chunk
    public List<Bitmap> createTiles(Bitmap map, int tileSize)
    {
      List<Bitmap> imageTiles = new List<Bitmap>();

      int imgHeight = map.Height;
      int imgWidth = map.Width;

      int numberOfTiles = (int) (imgHeight / tileSize);

      for (int i = 0; i < numberOfTiles; i++)
      {
        for (int j = 0; j < numberOfTiles; j++)
        {
          Rectangle copyRect = new Rectangle(i * tileSize, j * tileSize, tileSize, tileSize);
          System.Drawing.Imaging.PixelFormat format = map.PixelFormat;
          Bitmap newTile = map.Clone(copyRect, format);

          imageTiles.Add(newTile);
        }
      }

      return imageTiles;
    }


    // This method generates a data array of binary values to represent present(1) or absent(0) voxels
    public int[,,] generateDataArray(Bitmap map, double heightScaling)
    {
      // The supplied image should always have the same Height and Width
      int[,,] dataArray = new int[map.Width, map.Height, 128];

      for (int x = 0; x < map.Width; x++)
      {
        for (int y = 0; y < map.Height; y++)
        {
          // The number of voxels in the Z direction is determined by the brightness of the pixel at the (X, Y) coordinates
          Color pixelColor = map.GetPixel(x, y);
          int pixelBrightness = Remap(pixelColor.GetBrightness(), map.Height, heightScaling);

          for (int z = 0; z < 128; z++)
          {
            // If the current position in the array is higher than the brightness, create an empty voxel
            if(z > pixelBrightness) dataArray[x, y, z] = 0;

            else dataArray[x, y, z] = 1;

          }
        }
      }

      return dataArray;
    }


    // This method generates a list of data arrays (one for each chunk)
    public List<int[,,]> generateWorldData(int tileSize, double heightScaling)
    {
      List<Bitmap> imageTiles = createTiles(finalMap, tileSize);

      List<int[,,]> worldData = new List<int[,,]>();

      for (int i = 0; i < imageTiles.Count; i++)
      {
        worldData.Add(generateDataArray(imageTiles[i], heightScaling));
      }

      return worldData;
    }

  }




  // PART 2: CLASSES THAT DEAL WITH VOXEL, CHUNK & WORLD MESH GENERATION


  // This enum contains the orientation of the faces of a voxel in the orde they are created
  public enum Direction {Bottom, South, East, North, West, Top}

  // This enum contains the different types of voxels that can exist
  public enum VoxelType {Grass, Stone, Snow, Water, NotImplemented}



  // CLASS 1: WORLD
  // This class enables the creation of a voxel world out of multiple chunks
  public class World
  {
    // Fields
    private List<VoxelChunkMesh> chunks;
    public List<Mesh> chunkMehses;

    // Constructor
    public World(List<VoxelChunkData> chunksData, double heightScaling)
    {
      chunks = new List<VoxelChunkMesh>();
      chunkMehses = new List<Mesh>();

      int chunkX = 0;
      int chunkY = 0;

      for (int i = 0; i < chunksData.Count; i++)
      {
        Point3d chunkOrigin = new Point3d(chunkX * 16, chunkY * 16, 0);

        chunkY += 1;

        if (chunkY >= Math.Sqrt(chunksData.Count))
        {
          chunkY = 0;
          chunkX += 1;
        }

        VoxelChunkMesh newChunk = new VoxelChunkMesh(chunksData[i], heightScaling);

        chunks.Add(newChunk);
        chunkMehses.Add(newChunk.mesh);
      }
    }

  }


  // CLASS 2: VOXEL CHUNK DATA
  // This class holds the data for a cluster of voxels, which will be used to create a mesh
  // It holds an array that determines in what positions voxels exist (1) or do not exist (0)
  public class VoxelChunkData
  {
    // Fields
    public int[,,] data;

    // orientations holds the data that determines in which direction "North", "South", "West" etc are in relation to a voxel
    VoxelCoordinates[] orientations = {
      new VoxelCoordinates (0, 0, -1),
      new VoxelCoordinates (0, -1, 0),
      new VoxelCoordinates (1, 0, 0),
      new VoxelCoordinates (0, 1, 0),
      new VoxelCoordinates (-1, 0, 0),
      new VoxelCoordinates (0, 0, 1)
      };

    // Constructor
    public VoxelChunkData(int[,,] receivedData)
    {
      this.data = receivedData;
    }

    // Methods

    // Get the number of elements in the first dimension of the array (width)
    public int Width
    {
      get {return data.GetLength(0);}
    }

    // Get the number of elements in the second dimension of the array (depth)
    public int Depth
    {
      get {return data.GetLength(1);}
    }

    // Get the number of elements in the third dimension of the array (height)
    public int Height
    {
      get {return data.GetLength(2);}
    }

    // Get the voxel data at the specified position in the array
    public int GetVoxel(int x, int y, int z)
    {
      return data[x, y, z];
    }

    // Check the neighbouring voxel of the specified voxel, in the specified direction.
    public int CheckNeighbour(int x, int y, int z, Direction direction)
    {
      VoxelCoordinates currentVoxelCheck = orientations[(int) direction];
      VoxelCoordinates neighbourCoordinates = new VoxelCoordinates(x + currentVoxelCheck.x, y + currentVoxelCheck.y, z + currentVoxelCheck.z);

      // An element is out of bounds if the neighbour coordinates are smaller than 0 or larger than the dimensions of the data array
      bool isOutOfBounds = (
        neighbourCoordinates.x < 0 || neighbourCoordinates.x >= Width ||
        neighbourCoordinates.y < 0 || neighbourCoordinates.y >= Depth ||
        neighbourCoordinates.z < 0 || neighbourCoordinates.z >= Height
        );

      if(isOutOfBounds) return 0;
      else return GetVoxel(neighbourCoordinates.x, neighbourCoordinates.y, neighbourCoordinates.z);
    }

    // Structure that holds the voxel coordinates information (in terms of position in data array, not world coordinates)
    struct VoxelCoordinates
    {
      public int x;
      public int y;
      public int z;

      public VoxelCoordinates(int x, int y, int z)
      {
        this.x = x;
        this.y = y;
        this.z = z;
      }
    }
  }


  // CLASS 3: VOXEL CHUNK MESH
  // This class creates a mesh from all the voxel data it received as an input
  public class VoxelChunkMesh
  {
    // Fields
    public VoxelChunkData voxelData;
    public Mesh mesh;


    // Constructor
    public VoxelChunkMesh(VoxelChunkData voxelData, double heightScaling)
    {
      this.voxelData = voxelData;

      mesh = new Mesh();

      // When iterating through the voxelData, keep track of what the current voxel index is
      int voxelIndex = 0;

      for (int z = 0; z < voxelData.Height; z++)
      {
        for (int y = 0; y < voxelData.Depth; y++)
        {
          for (int x = 0; x < voxelData.Width; x++)
          {
            if(voxelData.GetVoxel(x, y, z) == 1)
            {
              Point3d voxelOrigin = new Point3d(x, y, z);
              MakeVoxel(voxelOrigin, voxelIndex, heightScaling);

              voxelIndex += 1;
            }
          }
        }
      }
    }

    // Methods

    // This method creates a voxel/cube mesh with the specified parameters
    public void MakeVoxel(Point3d position, int voxelIndex, double heightScaling)
    {
      int chance = rnd.Next(0, 101);

      // Check the neighbours of the current voxel in order to determine what faces to add
      // If the voxel is next to another voxel, there is no point in creating a face in between them
      List<int> voxelNeighbours = new List<int>();
      voxelNeighbours.Add(voxelData.CheckNeighbour((int) position.X, (int) position.Y, (int) position.Z, Direction.Bottom));
      voxelNeighbours.Add(voxelData.CheckNeighbour((int) position.X, (int) position.Y, (int) position.Z, Direction.South));
      voxelNeighbours.Add(voxelData.CheckNeighbour((int) position.X, (int) position.Y, (int) position.Z, Direction.East));
      voxelNeighbours.Add(voxelData.CheckNeighbour((int) position.X, (int) position.Y, (int) position.Z, Direction.North));
      voxelNeighbours.Add(voxelData.CheckNeighbour((int) position.X, (int) position.Y, (int) position.Z, Direction.West));
      voxelNeighbours.Add(voxelData.CheckNeighbour((int) position.X, (int) position.Y, (int) position.Z, Direction.Top));

      // Create the vertices for the current voxel's mesh
      mesh.Vertices.AddVertices(Voxel.voxelVertices(position));
      // Create the faces for the current voxel's mesh, based on what neighbours it has
      mesh.Faces.AddFaces(Voxel.voxelFaces(voxelIndex, position, voxelNeighbours));
      // Add colours to the voxels based on their types (Stone, Grass, etc)
      mesh.VertexColors.AppendColors(Voxel.vertexColours(Voxel.assignVoxelType(position, voxelData.Height, heightScaling * 7, chance)));
    }
  }


  // CLASS 4: VOXEL
  // This static class holds the functionality required to create a single voxel/cube mesh
  public static class Voxel
  {
    // Methods

    // This method returns the 8 vertices of a voxel, based on the voxel's position
    public static Point3d[] voxelVertices(Point3d position)
    {
      // Define the position of the 8 vertices of the voxel/cube
      Point3d point1 = new Point3d(position.X, position.Y, position.Z);
      Point3d point2 = new Point3d(position.X + 1, position.Y, position.Z);
      Point3d point3 = new Point3d(position.X + 1, position.Y + 1, position.Z);
      Point3d point4 = new Point3d(position.X, position.Y + 1, position.Z);
      Point3d point5 = new Point3d(position.X, position.Y, position.Z + 1);
      Point3d point6 = new Point3d(position.X + 1, position.Y, position.Z + 1);
      Point3d point7 = new Point3d(position.X + 1, position.Y + 1, position.Z + 1);
      Point3d point8 = new Point3d(position.X, position.Y + 1, position.Z + 1);

      Point3d[] vertices = {point1, point2, point3, point4, point5, point6, point7, point8};

      return vertices;
    }

    // This method returns the 6 faces of a voxel, based on the voxel's index in the chunk data structure
    public static MeshFace[] voxelFaces(int voxelIndex, Point3d position, List<int> neighbours)
    {
      List<MeshFace> faces = new List<MeshFace>();

      // Define the 6 faces of the voxel/cube and add them to the list of faces if they are exposed
      // (If a face is hidden in between 2 voxels, do not add it)
      if(neighbours[0] == 0 && position.Z > 0)
      {
        MeshFace face1 = new MeshFace(0 + voxelIndex * 8, 3 + voxelIndex * 8, 2 + voxelIndex * 8, 1 + voxelIndex * 8); // Bottom face
        faces.Add(face1);
      }

      if(neighbours[1] == 0)
      {
        MeshFace face2 = new MeshFace(0 + voxelIndex * 8, 1 + voxelIndex * 8, 5 + voxelIndex * 8, 4 + voxelIndex * 8); // South face
        faces.Add(face2);
      }

      if(neighbours[2] == 0)
      {
        MeshFace face3 = new MeshFace(1 + voxelIndex * 8, 2 + voxelIndex * 8, 6 + voxelIndex * 8, 5 + voxelIndex * 8); // East face
        faces.Add(face3);
      }

      if(neighbours[3] == 0)
      {
        MeshFace face4 = new MeshFace(2 + voxelIndex * 8, 3 + voxelIndex * 8, 7 + voxelIndex * 8, 6 + voxelIndex * 8); // North face
        faces.Add(face4);
      }

      if(neighbours[4] == 0)
      {
        MeshFace face5 = new MeshFace(3 + voxelIndex * 8, 0 + voxelIndex * 8, 4 + voxelIndex * 8, 7 + voxelIndex * 8); // West face
        faces.Add(face5);
      }

      if(neighbours[5] == 0)
      {
        MeshFace face6 = new MeshFace(4 + voxelIndex * 8, 5 + voxelIndex * 8, 6 + voxelIndex * 8, 7 + voxelIndex * 8); // Top face
        faces.Add(face6);
      }

      return faces.ToArray();
    }

    // Method that adds vertex colors to the mesh
    public static Color[] vertexColours(VoxelType voxelType)
    {
      Color voxelColour;
      Color[] vertexColours = new Color[8];

      if (voxelType == VoxelType.Grass)
      {
        voxelColour = Color.Green;
      }

      else if (voxelType == VoxelType.Stone)
      {
        voxelColour = Color.Gray;
      }

      else if (voxelType == VoxelType.Snow)
      {
        voxelColour = Color.Snow;
      }

      else if (voxelType == VoxelType.Water)
      {
        voxelColour = Color.Blue;
      }

      else
      {
        voxelColour = Color.Empty;
      }

      for (int i = 0; i < 8; i++)
      {
        vertexColours[i] = voxelColour;
      }

      return vertexColours;
    }

    // Method that determines the type of the voxel -> used to color the vertices of individual voxels in vertexColours method
    public static VoxelType assignVoxelType(Point3d position, int chunkHeight, double cutOff, int chance)
    {
      VoxelType voxelType;

      int currentVoxelHeight = (int) position.Z;

      if (currentVoxelHeight <= 0)
      {
        voxelType = VoxelType.Water;
      }

      else if (currentVoxelHeight < (int) (chunkHeight / cutOff - 1) && currentVoxelHeight > 0)
      {
        voxelType = VoxelType.Grass;
      }

      else if (currentVoxelHeight >= (int) (chunkHeight / cutOff - 1) && currentVoxelHeight < (int) (chunkHeight / cutOff + 1) )
      {
        if (chance < 66) voxelType = VoxelType.Grass;
        else voxelType = VoxelType.Stone;
      }

      else if ((currentVoxelHeight >= (int) (chunkHeight / cutOff + 1)) && (currentVoxelHeight < (int) (chunkHeight * 2 / cutOff - 1)))
      {
        voxelType = VoxelType.Stone;
      }

      else if ((currentVoxelHeight >= (int) (chunkHeight * 2 / cutOff - 1)) && (currentVoxelHeight < (int) (chunkHeight * 2 / cutOff + 1)))
      {
        if (chance < 66) voxelType = VoxelType.Stone;
        else voxelType = VoxelType.Snow;
      }

      else
      {
        voxelType = VoxelType.Snow;
      }

      return voxelType;
    }
  }



  // PART 3: CLASSES THAT DEAL WITH POPULATING THE WORLD WITH ASSETS (SUCH AS FORESTS)

  // CLASS 1: TREE
  // Create a mesh tree to be used in the Forest class
  public class Tree
  {
    // Fields
    public Mesh treeMesh = new Mesh();

    public Point3d treeLocation;
    public double height;
    public Color crownColour;

    // Constructor
    public Tree(Point3d origin, double height, Color crownColour)
    {
      this.treeLocation = new Point3d(origin.X + 0.5, origin.Y + 0.5, origin.Z + 1);
      this.height = height;
      this.crownColour = crownColour;

      Point3d trunkTop = new Point3d(treeLocation.X, treeLocation.Y, treeLocation.Z + height);
      Line trunkLine = new Line(treeLocation, trunkTop);
      Cylinder trunkCylinder = new Cylinder(new Circle(treeLocation, 0.1), height);

      Mesh trunk = Mesh.CreateFromCylinder(trunkCylinder, 1, 5);

      foreach (var vertex in trunk.Vertices)
      {
        trunk.VertexColors.Add(Color.Brown);
      }

      double crownRadius = height * 0.55;
      Sphere crownSphere = new Sphere(trunkTop, crownRadius);

      Mesh crown = Mesh.CreateFromSphere(crownSphere, 10, 10);

      foreach (var vertex in crown.Vertices)
      {
        crown.VertexColors.Add(crownColour);
      }

      treeMesh.Append(trunk);
      treeMesh.Append(crown);

    }

  }



  // CLASS 2: FOREST
  // This class creates forests based on an input heightmap
  public class Forest
  {
    // Fields
    public Bitmap terrainMap;
    public List<Mesh> trees = new List<Mesh>();

    // Constructor
    public Forest(Bitmap terrainMap, double heightScaling)
    {
      // Create trees with different parameters based on the height of their location
      this.terrainMap = terrainMap;

      Random rnd = new Random();

      for (int x = 0; x < terrainMap.Width; x++)
      {
        for (int y = 0; y < terrainMap.Height; y++)
        {
          Color pixelColor = terrainMap.GetPixel(x, y);
          int pixelBrightness = Remap(pixelColor.GetBrightness(), terrainMap.Height, heightScaling);

          if(pixelBrightness > (128 / (heightScaling * 7)) && pixelBrightness < ((128 * 2) / (heightScaling * 3)))
          {
            if(rnd.NextDouble() < 0.09)
            {
              Color crownColour = Color.FromArgb(rnd.Next(75, 125), rnd.Next(150, 200), rnd.Next(70, 100));

              Tree newTree = new Tree(new Point3d(x, y, (int) (pixelBrightness / 8)), rnd.Next(1, 3), crownColour);
              trees.Add(newTree.treeMesh);
            }
          }

          else if (pixelBrightness > ((128 * 2) / (heightScaling * 3)) && pixelBrightness < (128 / heightScaling))
          {
            if(rnd.NextDouble() < 0.035)
            {
              Color crownColour = Color.FromArgb(rnd.Next(195, 200), rnd.Next(150, 200), rnd.Next(70, 100));

              Tree newTree = new Tree(new Point3d(x, y, (int) (pixelBrightness * 2 / (heightScaling * 8))), rnd.Next(1, 3), crownColour);
              trees.Add(newTree.treeMesh);
            }
          }

        }
      }
    }

    // Methods
  }
# ---------- end voxel_world_creation ----------

# ---- group: VOXEL WORLD / Post-Generation
# Terrain Display: If you select "show player vicinity" from the drop-down list, click on the small component below labelled "Player", and move the selected point around to see changes take effect.
# 
# Note: Do not move the Player point while "show whole world" is selected, it will have no effect other than lag.
list_3 = ValueList({"Show whole world": "world", "Show player vicinity": "vicinity"}, selected="Show whole world")
player = Point(Point(50.48755943, 30.18092528, 13.26735518))
voxel_world_post_creation = CSharpScript(
    inputMesh=voxel_world_creation.VoxelWorldMesh,
    inputTrees=voxel_world_creation.ForestMeshes,
    display=list_3,
    player=player)  # -> out, worldMesh, OutputTreeMeshes; inputs inputMesh: list of Mesh, inputTrees: list of Mesh, display: String, player: Point3d
# ---------- voxel_world_post_creation: C# ----------
    // RUNTIME CODE:

    WorldProcessing world = new WorldProcessing(inputMesh);

    if(voxelWorld != world)
    {
      voxelWorld = world;
    }


    voxelWorld.arrangeChunks(voxelWorld.chunks[voxelWorld.chunks.Count - 1].Vertices[0] != Point3d.Origin, 16);

    if(inputTrees != storedTreeMeshes)
    {
      storedTreeMeshes = inputTrees;
      treeChunkCorrelation = new Dictionary<int, List<Mesh>>();
    }


    // OUTPUT:

    if(display == "world")
    {
      worldMesh = voxelWorld.chunks;
      OutputTreeMeshes = inputTrees;
    }

    else if(display == "vicinity")
    {
      voxelWorld.createChunkCorrelation();
      voxelWorld.displayChunks(player);

      if(treeChunkCorrelation.Count == 0)
      {
        TreeUtility.AssignChunk(inputTrees);
      }

      worldMesh = voxelWorld.outputChunks;
      OutputTreeMeshes = TreeUtility.DisplayTrees(player);
    }
# ---------- voxel_world_post_creation: C# additional code ----------
  // CODE:

  public WorldProcessing voxelWorld;
  public List<Mesh> storedTreeMeshes;

  // This Dict holds a correlation between chunk index and chunk position. Will be used to associate tree meshes with chunks
  public static Dictionary<Point2d, int> chunkIndexCorrelation = new Dictionary<Point2d, int>();
  // This Dict holds a correlation between chunk and tree meshes
  public static Dictionary<int, List<Mesh>> treeChunkCorrelation = new Dictionary<int, List<Mesh>>();

  // Enum holding cardinal directions for determining chunk positions and neighbours
  public enum WorldDirection {South, East, North, West};


  // CLASS 1:
  // This class enables some functionality attributed to the world mesh after it is created
  public class WorldProcessing
  {
    // Fields
    public List<Mesh> chunks;
    public List<Mesh> outputChunks;

    private int storedChunkIndex;

    // Constructor
    public WorldProcessing(List<Mesh> inputMeshes)
    {
      this.chunks = inputMeshes;
    }

    // Methods

    // Move the chunks to position if they are not arranged
    public void arrangeChunks(bool inPosition, int chunkSize)
    {
      int chunkX = 0;
      int chunkY = 0;

      if(!inPosition)
      {
        for (int i = 0; i < chunks.Count; i++)
        {
          chunks[i].Transform(Transform.Translation(new Vector3d(chunkX * chunkSize, chunkY * chunkSize, 0)));

          chunkY += 1;

          if (chunkY >= Math.Sqrt(chunks.Count))
          {
            chunkY = 0;
            chunkX += 1;
          }
        }
      }
    }

    // Determine a correlation between chunk index and chunk position.
    public void createChunkCorrelation()
    {
      for (int i = 0; i < chunks.Count; i++)
      {
        chunkIndexCorrelation[new Point2d(chunks[i].GetBoundingBox(true).Center)] = i;
      }
    }

    // Control what chunks are displayed based on the player's position.
    public void displayChunks(Point3d player)
    {
      if(outputChunks == null)
      {
        outputChunks = new List<Mesh>();
      }

      // Clamp player position input
      if (player.X < 0) player = new Point3d(0, player.Y, 0);
      if (player.X > Math.Sqrt(chunks.Count) * 16) player = new Point3d(Math.Sqrt(chunks.Count) * 16, player.Y, 0);
      if (player.Y < 0) player = new Point3d(player.X, 0, 0);
      if (player.Y > Math.Sqrt(chunks.Count) * 16) player = new Point3d(player.X, Math.Sqrt(chunks.Count) * 16, 0);

      // Estimate the origin position of the chunk that the player is currently in
      Point3d currentChunkPosition = new Point3d(player.X - (player.X % 16), player.Y - (player.Y % 16), 0);

      // Determine the index of the current chunk based on its position
      int currentChunkIndex = (int) ((currentChunkPosition.X / 16) * Math.Sqrt(chunks.Count) + currentChunkPosition.Y / 16);

      if(currentChunkIndex != storedChunkIndex)
      {
        storedChunkIndex = currentChunkIndex;
        outputChunks.Clear();

        // Find all the neighbouring chunks of the current chunk
        List<int> neighbourIndices = ChunkUtility.neigbourChunks(currentChunkIndex, chunks.Count);

        foreach(int index in neighbourIndices)
        {
          outputChunks.Add(chunks[index]);
        }

        outputChunks.Add(chunks[currentChunkIndex]);
      }

    }

  }



  // CLASS 2:
  // Static class that enables checking chunk indices and neighbours
  public static class ChunkUtility
  {
    // Method that determines whether a chunk is at the edge of the world or not
    public static bool isAtEdge(int index, int listLength, WorldDirection  direction)
    {
      if(index < 0 || index > listLength) return true;

      int cutoff = (int) Math.Sqrt(listLength);

      if(direction == WorldDirection.South)
      {
        return (index - cutoff < 0);
      }

      else if(direction == WorldDirection.East)
      {
        return (index % cutoff == cutoff - 1);
      }

      else if(direction == WorldDirection.North)
      {
        return (index + cutoff > listLength);
      }

      else if(direction == WorldDirection.West)
      {
        return (index % cutoff == 0);
      }

      return false;
    }

    // Method that returns the indices of the neighbouring chunks
    public static List<int> neigbourChunks(int currentChunk, int listLength)
    {
      List<int> neighbours;

      int cutoff = (int) Math.Sqrt(listLength);

      // Based on a chunk's position, determine what neighbours it has
      // Positions include: on the sides of the world, in the corners of the world, in the middle of the world

      if(isAtEdge(currentChunk, listLength, WorldDirection.South))
      {
        if(isAtEdge(currentChunk, listLength, WorldDirection.West))
        {
          neighbours = new List<int>() {currentChunk + cutoff, currentChunk + 1, currentChunk + cutoff + 1};
        }

        else if(isAtEdge(currentChunk, listLength, WorldDirection.East))
        {
          neighbours = new List<int>() {currentChunk - 1, currentChunk + cutoff, currentChunk + cutoff - 1};
        }

        else
        {
          neighbours = new List<int>() {currentChunk - 1, currentChunk + 1, currentChunk + cutoff, currentChunk + cutoff + 1, currentChunk + cutoff - 1};
        }
      }

      else if(isAtEdge(currentChunk, listLength, WorldDirection.North))
      {
        if(isAtEdge(currentChunk, listLength, WorldDirection.West))
        {
          neighbours = new List<int>() {currentChunk - cutoff, currentChunk + 1, currentChunk + cutoff + 1};
        }

        else if(isAtEdge(currentChunk, listLength, WorldDirection.East))
        {
          neighbours = new List<int>() {currentChunk - 1, currentChunk - cutoff, currentChunk - cutoff - 1};
        }

        else
        {
          neighbours = new List<int>() {currentChunk - 1, currentChunk + 1, currentChunk - cutoff, currentChunk - cutoff + 1, currentChunk - cutoff - 1};
        }
      }

      else if(isAtEdge(currentChunk, listLength, WorldDirection.West))
      {
        neighbours = new List<int>() {currentChunk + cutoff, currentChunk - cutoff, currentChunk + 1, currentChunk - cutoff + 1, currentChunk + cutoff + 1};
      }

      else if(isAtEdge(currentChunk, listLength, WorldDirection.East))
      {
        neighbours = new List<int>() {currentChunk + cutoff, currentChunk - cutoff, currentChunk - 1, currentChunk - cutoff - 1, currentChunk + cutoff - 1};
      }

      else
      {
        neighbours = new List<int>() {currentChunk - 1, currentChunk + 1, currentChunk - cutoff, currentChunk + cutoff, currentChunk - cutoff - 1, currentChunk - cutoff + 1, currentChunk + cutoff - 1, currentChunk + cutoff + 1};
      }

      return neighbours;
    }
  }



  // CLASS 2: TREE UTILITY
  // This class assigns the input tree meshes to a chunk using indices and Point2d positions 
  // stored in the Dicts at the start of "Custom additional code"
  public static class TreeUtility
  {
    // Methods

    // This method iterates through input trees and determines their associated chunks
    public static void AssignChunk(List<Mesh> trees)
    {
      for (int i = 0; i < trees.Count; i++)
      {
        Point2d currentTreePosition = new Point2d(trees[i].GetBoundingBox(true).Center);

        Point2d associatedChunkPosition = new Point2d(currentTreePosition.X - (currentTreePosition.X % 16) + 8, currentTreePosition.Y - (currentTreePosition.Y % 16) + 8);
        int associatedChunkIndex = chunkIndexCorrelation[associatedChunkPosition];


        if(!treeChunkCorrelation.ContainsKey(associatedChunkIndex))
        {
          treeChunkCorrelation.Add(associatedChunkIndex, new List<Mesh>());
        }

        treeChunkCorrelation[associatedChunkIndex].Add(trees[i]);
      }
    }

    // Display the trees in the vicinity of the player
    public static List<Mesh> DisplayTrees(Point3d player)
    {
      List<Mesh> vicinityTrees = new List<Mesh>();

      // Estimate the origin position of the chunk that the player is currently in
      Point3d currentChunkPosition = new Point3d(player.X - (player.X % 16), player.Y - (player.Y % 16), 0);

      // Determine the index of the current chunk based on its position
      int currentChunkIndex = (int) ((currentChunkPosition.X / 16) * 8 + currentChunkPosition.Y / 16);

      List<int> neighbours = ChunkUtility.neigbourChunks(currentChunkIndex, 64);
      neighbours.Add(currentChunkIndex);

      foreach (int index in neighbours)
      {
        if(treeChunkCorrelation.ContainsKey(index))
        {
          vicinityTrees.AddRange(treeChunkCorrelation[index]);
        }
      }

      return vicinityTrees;
    }
  }
# ---------- end voxel_world_post_creation ----------

# ---- group: Display
swatch = ColourSwatch(SwatchColor=RGB(0, 0, 0))
terrain = CustomPreview(Geometry=voxel_world_post_creation.worldMesh, Material=swatch)
# Set curve that defines camera path  --->
# Set the number of camera positions along that curve (how smooth the animation will be)   --->
# Animate slider to create video frames  --->
# Set the path to the DIRECTORY (folder) in which the images are kept --->
# Set the path to the DIRECTORY (folder) in which the images are kept --->
# Set the path to the DIRECTORY (folder) in which the images are kept --->
# Set the path to the DIRECTORY (folder) in which the images are kept --->
trees = CustomPreview(Geometry=voxel_world_post_creation.OutputTreeMeshes, Material=swatch)
